# Grasshopper definition Tesellations.gh (Grasshopper 1.0.7)
# plug-ins: V-Ray For Grasshopper 6, LunchBox

number_slider = Slider(425, range=0..1000)
timeline = VRayTimeline(FramesCount=number_slider, RangeStart=Slider(334, range=0..1000), RangeEnd=Slider(424, range=0..1000))  # -> Timeline, CurrentFrame, CurrentFraction
number_slider_2 = Slider(20, range=0..100)
pi = Pi(Factor=1)
subtraction = Subtraction(A=number_slider, B="1")
box = CenterBox(Base=PlaneXY(0, 0, 0), X=number_slider_2, Y=number_slider_2, Z=number_slider_2)
dom = ConstructDomain(DomainStart=0, DomainEnd=pi)
dom_2 = ConstructDomain(DomainStart=0, DomainEnd=subtraction)
remap = RemapNumbers(Value=timeline.CurrentFrame, Source=dom_2, Target=Domain(0, 1))  # -> Mapped, Clipped
md_slider = MDSlider(SliderMode=0, slider_value=Point(0.5, 0.5, 0.5), x_domain=Domain(0, 1), y_domain=Domain(0, 1), z_domain=Domain(0, 1))
remap_2 = RemapNumbers(Value=timeline.CurrentFrame, Source=dom_2, Target=dom)  # -> Mapped, Clipped
cos = Cosine(Value=remap_2.Mapped)
sin = Sine(Value=remap_2.Mapped)
abs = Absolute(Value=cos)
platoicosa = PlatonicIcosahedron(Plane=PlaneXY(0, 0, 0), Radius=Slider(50, range=0..100), Truncation=abs)
debrep = DeconstructBrep(Brep=platoicosa)  # -> graft(Faces), Edges, Vertices
edges = BrepEdges(Brep=debrep.Faces)  # -> Naked, Interior, NonManifold
area = Area(Geometry=debrep.Faces)  # -> Area, Centroid
join = JoinCurves(Curves=edges.Naked, Preserve=False)  # -> simplify(Curves)
range = Range(Domain=Domain(0, 1), Steps=Slider(5, range=0..10))
pi_2 = Pi(Factor=Slider(0.3, range=0..1))
evalsrf = EvaluateSurface(Surface=debrep.Faces, Point=md_slider)  # -> Point, Normal, UDirection, VDirection, Frame
multiplication = Multiplication(A=sin, B=pi_2)
graph = GraphMapper(
    range,
    x0=0,
    x1=1,
    y0=0,
    y1=1,
    container_name="Bezier",
    cpx=[0, 0.3973587453, 0.4470612407, 1],
    cpy=[0.1851771474, 0.5181902647, 0.5590767264, 1])
subtraction_2 = Subtraction(A=graph, B=remap.Mapped)
panel = Panel(subtraction_2)
cull_i = CullIndex(List=panel, Indices="0", Wrap=True)
c_script = CSharpScript(x=panel)  # -> out, A; inputs x: list of Double
# ---------- c_script: C# ----------
    List<double> d = new List<double>();
    double te;
    int cap = x.Count;
    for(int i = 0;i < cap;i++){
      te = x[i];
      if(te < 0.05){
        x.Add(te + 1);
        x.RemoveAt(i);
        i--;
        cap--;
      }
    }
    if(x[x.Count - 1] < 1)
      x.Add(1);
    if(x[x.Count - 1] > 1)
      x[x.Count - 1] = 1;
    if(x[0] == 0){
      x.RemoveAt(0);
    }

    A = x;
# ---------- end c_script ----------
panel_2 = Panel(c_script.A)
scale = Scale(Geometry=join, Center=area.Centroid, Factor=panel_2)  # -> Geometry, Transform
pi_3 = Pi(Factor=1)
dom_3 = ConstructDomain(DomainStart=0, DomainEnd=pi_3)
remap_3 = RemapNumbers(Value=timeline.CurrentFrame, Source=dom_2, Target=dom_3)  # -> Mapped, Clipped
number_slider_3 = Slider(1, range=0..1)
toggle = BooleanToggle(False)
neg = Negative(Value=number_slider_3)
shift = ShiftList(List=scale.Geometry, Shift=neg, Wrap=toggle)
shift_2 = ShiftList(List=scale.Geometry, Shift=number_slider_3, Wrap=toggle)
graft = GraftTree(Tree=simplify(shift), IncludeEmptyLists=True, IncludeNullItems=True)
graft_2 = GraftTree(Tree=simplify(shift_2), IncludeEmptyLists=True, IncludeNullItems=True)
loft = Loft(
    Curves=[graft, graft_2],
    Options={Adjust=False, Closed=False, LoftEnds=0, LoftSimp=0, LoftType=0, Rebuild=10, Refit=0.01})
item = ListItem(List=scale.Geometry, Index=0, Wrap=True)
path_mapper = PathMapper(loft, source="{A;B}", target="{A}")
boundary = BoundarySurfaces(Edges=item)  # -> simplify(Surfaces)
merge = Merge(Data1=boundary, Data2=path_mapper)
lng = ListLength(List=merge)
subtraction_3 = Subtraction(A=lng, B="1")
range_2 = Range(Domain=Domain(0, 1), Steps=subtraction_3)
graph_2 = GraphMapper(
    range_2,
    x0=0,
    x1=1,
    y0=0,
    y1=1,
    container_name="Bezier2",
    pt=[Point(0, 1, 0), Point(0.1255555153, 0.8607850075, 0), Point(0.18927975, 0.7121511698, 0), Point(0.315893203, 0.4847589135, 0), Point(0.4611040371, 0.2239665695, 0), Point(0.661341548, 0, 0), Point(1, 0, 0)])
number_slider_4 = Slider(5, range=0..100)
graph_3 = GraphMapper(
    panel_2,
    x0=0,
    x1=1,
    y0=0,
    y1=1,
    container_name="Bezier2",
    pt=[Point(0, 1, 0), Point(0.1255555153, 0.8607850075, 0), Point(0.18927975, 0.7121511698, 0), Point(0.315893203, 0.4847589135, 0), Point(0.4611040371, 0.2239665695, 0), Point(0.7599205375, 0.09212237597, 0), Point(1, 0, 0)])
multiplication_2 = Multiplication(A=number_slider_4, B=graph_2)
panel_3 = Panel(multiplication_2)
multiplication_3 = Multiplication(A=graph_3, B=number_slider_4)
amp = Amplitude(Vector=evalsrf.Normal, Amplitude=multiplication_3)
neg_2 = Negative(Value=amp)
move = Move(Geometry=merge, Motion=neg_2)  # -> Geometry, Transform
neg_3 = Negative(Value="1")
shift_3 = ShiftList(List=neg_2, Shift=neg_3, Wrap=Toggle(True))
item_2 = ListItem(List=shift_3, Index="1", Wrap=True)
graft_3 = GraftTree(Tree=move.Geometry, IncludeEmptyLists=True, IncludeNullItems=True)
replace = ReplaceItems(List=shift_3, Item=item_2, Indices="0", Wrap=False)
graft_4 = GraftTree(Tree=replace, IncludeEmptyLists=True, IncludeNullItems=True)
extr = Extrude(Base=graft_3, Direction=graft_4)
group = Group(Objects=flatten(extr))
num = Number(multiplication)
pi_4 = Pi(Factor=Slider(0.18, range=0..1))
number_slider_5 = Slider(100, range=0..100)
addition = Addition(A=remap_3.Mapped, B=pi_4)
toggle_2 = BooleanToggle(False)
number_slider_6 = Slider(44, range=0..100)
number_slider_7 = Slider(157, range=0..1000)
cos_2 = Cosine(Value=addition)
sin_2 = Sine(Value=addition)
panel_4 = Panel("0")
maelstrom = Maelstrom(Geometry=group, Plane=PlaneXY(0, 0, 0), First=0.1, Second=number_slider_5, Angle=num, Rigid=toggle_2)
pi_5 = Pi(Factor=multiplication)
multiplication_4 = Multiplication(A=sin_2, B=number_slider_7)
pt = ConstructPoint(XCoordinate=Slider(34, range=0..100), YCoordinate=Slider(32, range=0..100), ZCoordinate=Slider(47, range=0..100))
multiplication_5 = Multiplication(A=number_slider_7, B=cos_2)
xz = XZPlane(Origin=Point(0, 0, 0))
multiplication_6 = Multiplication(A=sin_2, B=number_slider_6)
multiplication_7 = Multiplication(A=number_slider_6, B=cos_2)
mtl_file_path = VRayMaterialFromFile(
    "D:\Rhino_Grass\Tessel\Wood_229\Wood_229.vismat",
    File_Picker=0,
    File_Types="V-Ray materials (*.vrmat;*.vismat)|*.vrmat;*.vismat",
    Has_Extract_Parameter=True,
    Has_Manage_Collection=True,
    Has_Multiple_Files_Menu=False,
    Has_Picker_File_Menu=False,
    Multiple_Files=False)
pt_2 = ConstructPoint(XCoordinate=multiplication_7, YCoordinate=multiplication_6, ZCoordinate=Slider(0, range=0..100))
maelstrom_2 = Maelstrom(Geometry=maelstrom, Plane=xz, First=0.1, Second=number_slider_5, Angle=num, Rigid=toggle_2)
pt_3 = ConstructPoint(XCoordinate=multiplication_5, YCoordinate=multiplication_4, ZCoordinate=Slider(0, range=0..100))
yz = YZPlane(Origin=Point(0, 0, 0))
sampler = Sampler(1, Has_Extract_Parameter=False, Has_Manage_Collection=False, OptionsLength=2, Options=["Progressive", "Bucket"])
save_file = OutputImage(
    "D:\Rhino_Grass\Tessel\a.jpg",
    File_Picker=1,
    File_Types="Portable Network Graphics (*.png)|*.png|Windows bitmap (*.bmp)|*.bmp|Targa Image (*.tga)|*.tga|Radiance High-Dynamyc Range (*.hdr)|*.hdr|Silicon Graphics (*.sgi; *.rgb; *.rgba)|*.dgi;*.rgb;*.rgba|JPEG image (*.jpg; *.jpeg)|*.jpg;*.jpeg|OpenEXR image (*.exr)|*.exr|SoftImage PICT (*.pic)|*.pic|Tagged image (*.tif; *.tiff)|*.tif;*.tiff|V-Ray Raw Image (*.vrimg)|*.vrimg",
    Has_Extract_Parameter=False,
    Has_Manage_Collection=True,
    Has_Multiple_Files_Menu=False,
    Has_Picker_File_Menu=False,
    Multiple_Files=False)
quality = Quality(
    3,
    Has_Extract_Parameter=False,
    Has_Manage_Collection=False,
    OptionsLength=5,
    Options=["Draft", "Low", "Medium", "High", "Very High"])
engine = Engine(1, Has_Extract_Parameter=False, Has_Manage_Collection=False, OptionsLength=2, Options=["CPU", "GPU"])
mode = Mode(1, Has_Extract_Parameter=False, Has_Manage_Collection=False, OptionsLength=2, Options=["Interactive", "Production"])
maelstrom_3 = Maelstrom(Geometry=maelstrom_2, Plane=yz, First=0.1, Second=number_slider_5, Angle=num, Rigid=toggle_2)
light_rectangle = VRayLightRectangle(
    On=True,
    Position=pt,
    Target=Point(0, 0, 0),
    Color=RGB(255, 255, 255),
    Intensity=Slider(1.4, range=0..10),
    Invisible=True,
    Size=Slider(69, range=0..100))
number_slider_8 = Slider(1, range=0..1)
camera = VRayCamera(
    Position=pt_3,
    Target=pt_2,
    FOV=Slider(60, range=0..100),
    PhysicalExposureOn=Toggle(False),
    FNumber=8,
    ShutterSpeed1S=100,
    FilmSensitivity=625)  # -> Camera, Angle
ungroup = Ungroup(Group=maelstrom_3)
vgeo = VRayGeometry(Geo=ungroup, Material=mtl_file_path)
preview = CustomPreview(
    Geometry=ungroup,
    Material={diffuse=RGB(221, 160, 221), emission=RGB(66, 48, 66), shine=0.5, specular=RGB(255, 255, 255), transparency=0})
rig_dome = VRayLightRigDome(
    LightOn=True,
    Visible=True,
    Texture="D:\Rhino_Grass\Tessel\muddy_autumn_forest_16k.exr",
    Intensity=Slider(1, range=0..10),
    Rotation=Slider(100, range=0..100),
    BackgroundIntensity=Slider(0.66, range=0..1))
render = VRayRender(
    Engine=engine,
    Mode=mode,
    Sampler=sampler,
    Quality=quality,
    OutputImage=save_file,
    OutputResolution=[800, 800],
    Camera=camera.Camera,
    LightRig=rig_dome,
    VGeometry=flatten(vgeo),
    Timeline=timeline.Timeline)
